# Grasshopper definition Facade_screen_lb.gh (Grasshopper 1.0.7)

screen_length = Slider(25, range=5..30)
facade_depth = Slider(1, range=0..10)
screen_height = Slider(6, range=2..10)
aperturescale = Slider(93, range=20..100)
rotationangle = Slider(56, range=0..180)
number_slider = Slider(2, range=0..10)

rotationangle_2 = GetNumber(rotationangle, AtLeast=1, AtMost=2147483647, Maximum=1.797693135e+308, Minimum=-1.797693135e+308)
screen_length_2 = GetNumber(screen_length, AtLeast=1, AtMost=2147483647, Maximum=1.797693135e+308, Minimum=-1.797693135e+308)
screen_height_2 = GetNumber(screen_height, AtLeast=1, AtMost=2147483647, Maximum=1.797693135e+308, Minimum=-1.797693135e+308)
aperturescale_2 = GetNumber(aperturescale, AtLeast=1, AtMost=2147483647, Maximum=1.797693135e+308, Minimum=-1.797693135e+308)
facade_depth_2 = GetNumber(facade_depth, AtLeast=1, AtMost=2147483647, Maximum=1.797693135e+308, Minimum=-1.797693135e+308)
division = Division(ApertureScale=aperturescale_2, B=Slider(100, range=0..100))
panel = Panel(division)
panel_2 = Panel("""2
3""")
Y = UnitY(Factor=facade_depth_2)
xz = XZPlane(Origin=Point(0, 0, 0))
move = Move(Geometry=xz, Motion=Y)  # -> Geometry, Transform
rectangle = Rectangle(Plane=move.Geometry, XSize=screen_length_2, YSize=screen_height_2, Radius=0)  # -> Rectangle, Length
debrep = DeconstructBrep(Brep=rectangle.Rectangle)  # -> Faces, Edges, Vertices
rectangle_2 = Rectangle(Plane=xz, XSize=screen_length_2, YSize=screen_height_2, Radius=0)  # -> Rectangle, Length
debrep_2 = DeconstructBrep(Brep=rectangle_2.Rectangle)  # -> Faces, Edges, Vertices
ln = Line(StartPoint=debrep_2.Vertices, EndPoint=debrep.Vertices)
item = ListItem(List=ln, Index=panel_2, Wrap=True)
end = EndPoints(Curve=item)  # -> Start, End
item_2 = ListItem(List=end.Start, Index=0, Wrap=True)
item_3 = ListItem(List=end.End, Index="1", Wrap=True)
loft = Loft(Curves=item, Options={Adjust=False, Closed=False, LoftEnds=0, LoftSimp=0, LoftType=0, Rebuild=10, Refit=0.01})
boundary = BoundarySurfaces(Edges=rectangle.Rectangle)

Y_2 = UnitY(Factor=Slider(5, range=0..10))
facade_srf = Surface(boundary)
move_2 = Move(Geometry=facade_srf, Motion=Y_2)  # -> Geometry, Transform
rulesrf = RuledSurface(CurveA=facade_srf, CurveB=move_2.Geometry)
merge = Merge(Data1=rulesrf, Data2=move_2.Geometry)

ln_2 = Line(StartPoint=item_2, EndPoint=item_3)
boundary_curve = Curve(rectangle_2.Rectangle)
boundary_curve_2 = Curve(rectangle.Rectangle)
merge_2 = Merge(Data1=boundary, Data2=loft)
midpt = CurveMiddle(Curve=ln_2)
number_slider_2 = Slider(15, range=0..100)
loft_2 = Loft(
    Curves=[facade_srf, move_2.Geometry],
    Options={Adjust=False, Closed=False, LoftEnds=0, LoftSimp=0, LoftType=0, Rebuild=10, Refit=0.01})
project = Project(Geometry=midpt, Plane=PlaneXY(0, 0, 0))  # -> Geometry, Transform

debrep_3 = DeconstructBrep(Brep=boundary_curve)  # -> Faces, Edges, Vertices
bang = ExplodeTree(Data=graft(debrep_3.Edges))  # -> Branch0, Branch1, Branch2, Branch3
number_slider_3 = Slider(24, range=0..100)
curvepoint = PointOnCurve(bang.Branch3, parameter=0.5)
curvepoint_2 = PointOnCurve(bang.Branch1, parameter=0.5)
ln_3 = Line(StartPoint=curvepoint, EndPoint=curvepoint_2)
range = Range(Domain=Domain(0, 1), Steps=number_slider_3)
divide = DivideCurve(Curve=ln_3, Count=number_slider_3, Kinks=False)  # -> Points, Tangents, Parameters
graph = GraphMapper(range, x0=0, x1=-1, y0=0, y1=1, container_name="Sine", Equation_px=[0, 0.507895112], Equation_py=[0, 0.9974124432])
neg = Negative(Value=number_slider)
dom = ConstructDomain(DomainStart=number_slider, DomainEnd=neg)
remap = RemapNumbers(Value=graph, Source=Domain(0, 1), Target=graft(dom))  # -> Mapped, Clipped
Z = UnitZ(Factor=remap.Mapped)
move_3 = Move(Geometry=divide.Points, Motion=Z)  # -> Geometry, Transform
intcrv = Interpolate(Vertices=move_3.Geometry, Degree=3, Periodic=False, KnotStyle=1)  # -> Curve, Length, Domain

addition = Addition(A=screen_length, B=Slider(1, range=0..10))
merge_3 = Merge(Data1=loft_2, Data2=move_2.Geometry)
multiplication = Multiplication(A=addition, B=0.1)
cir = Circle(Plane=project.Geometry, Radius=addition)
context_shading = Surface(merge)
area = Area(Geometry=cir)  # -> Area, Centroid
srf = Surface(cir)
attractor_crv = Curve(intcrv.Curve)
srf_2 = Surface(boundary_curve)
area_2 = Area(Geometry=boundary_curve)  # -> Area, Centroid
xz_2 = XZPlane(Origin=area_2.Centroid)
rotate = Rotate(Geometry=attractor_crv, Angle=degrees(rotationangle_2), Plane=xz_2)  # -> Geometry, Transform
rotating_attractor_crv = Curve(rotate.Geometry)
crv = Curve(boundary_curve)
context_shading_2 = Surface(context_shading)
shading_srf = Surface(loft)

facade_srf_2 = Surface(boundary)
site_srf = Surface(srf)

# ----
# internalized
# geometries
context_shading_3 = Surface(context_shading_2)
facade_srf_3 = Surface(facade_srf_2)
site_srf_2 = Surface(srf)

# ----
# final massing geometries
# for detailed solar rad study
openingsforfinalmassing = Geometry([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])

finalmassing = Geometry(facade_srf_3)

# ----
# final massing
finalmassing_2 = Geometry([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])

shadingcontext = Geometry(context_shading_3)
sitegeometry = Geometry(site_srf_2)
compass = LBCompass(center=area.Centroid, scale=multiplication)  # -> compass; plug-in component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

# ----
# use this cluster to find surface normals
shownormal = ShowNormal()

# ----
# C:\Users\Gerald\Desktop\GERALD IAAC\TERM 2\2.S.3-Data_Management\Facade Screen Final Project\Rh + GH\CAPE_TOWN_SF-hour.epw
weather_data = Data("C:\Users\Gerald\Desktop\GERALD IAAC\TERM 2\2.S.3-Data_Management\Facade Screen Final Project\Rh + GH\CAPE_TOWN_SF-hour.epw")
panel_3 = Panel(weather_data)

# ----
# select specific hour
month = Slider(4, range=1..12)
day = Slider(1, range=1..31)
hour = Slider(15, range=1..24)

importepw = LBImportEPW(epw_file=weather_data)  # -> location, dry_bulb_temperature, dew_point_temperature, relative_humidity, wind_speed, wind_direction, direct_normal_rad, diffuse_horizontal_rad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; plug-in component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

python = GhPythonScript(x=hour)  # -> a
# ---------- python: Python ----------
__author__ = "arisv"
__version__ = "2021.10.04"

if x < 24:
    a = x + 1
else:
     a = 1
# ---------- end python ----------

analysisperiod = LBAnalysisPeriod(start_month=month, start_day=day, start_hour=hour, end_month=month, end_day=day, end_hour=python)  # -> period, hoys, dates; plug-in component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
skymatrix = LBCumulativeSkyMatrix(
    location=importepw.location,
    direct_rad=importepw.direct_normal_rad,
    diffuse_rad=importepw.diffuse_horizontal_rad,
    hoys=analysisperiod.hoys)  # -> report, sky_mtx; plug-in component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

list = ValueList({"simulate Massing + site": 0, "simulate only Massing": 1, "simulate only windows": 2}, selected="simulate only Massing")

merge_4 = Merge(
    Data1=ColourSwatch(SwatchColor=RGB(18, 11, 3)),
    Data2=ColourSwatch(SwatchColor=RGB(255, 132, 0)),
    Data3=ColourSwatch(SwatchColor=RGB(255, 251, 0)),
    Data4=ColourSwatch(SwatchColor=RGB(255, 254, 230)))
legendpar = LBLegendParameters(colors=merge_4, num_decimals="2")  # -> leg_par; plug-in component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
analysis_resolution = Panel("0.5")
analysis_resolution_2 = Panel("0.25")

# ---- group: RH_OUT_Surface
mesh = Mesh(flatten(srf))

# ---- group: RH_OUT:mesh
mesh_2 = Mesh(flatten(merge_2))

# ---- group: RH_OUT:Context
mesh_3 = Mesh(flatten(merge_3))

# ----
srf_3 = Surface(srf_2)
divide_2 = DivideDomain²(Domain=srf_3, UCount=Slider(51, range=0..100), VCount=Slider(20, range=0..100))
subsrf = Isotrim(Surface=srf_3, Domain=divide_2)
area_3 = Area(Geometry=subsrf)  # -> Area, Centroid
xz_3 = XZPlane(Origin=area_3.Centroid)
crv_cp = CurveClosestPoint(Point=area_3.Centroid, Curve=rotating_attractor_crv)  # -> Point, Parameter, Distance
polygon = Polygon(Plane=xz_3, Radius=Slider(0.13, range=0..1), Segments=Slider(3, range=3..9), FilletRadius=0)  # -> Polygon, Length
bnd = Bounds(Numbers=crv_cp.Distance)
remap_2 = RemapNumbers(Value=crv_cp.Distance, Source=bnd, Target="0.001 TO 1")  # -> Mapped, Clipped

multiplication_2 = Multiplication(A=remap_2.Mapped, B=division)

scale = Scale(Geometry=polygon.Polygon, Center=area_3.Centroid, Factor=multiplication_2)  # -> Geometry, Transform
srf_4 = Surface(scale.Geometry)
screen_surface = Surface(srf_4)
srfsplit = SurfaceSplit(Surface=srf_3, Curves=flatten(scale.Geometry))
srf_5 = Surface(flatten(srfsplit))
item_4 = ListItem(List=srfsplit, Index=0, Wrap=True)

crv_2 = Curve(flatten(scale.Geometry))
merge_5 = Merge(Data1=crv, Data2=crv_2)
screen_surface_2 = Surface(item_4)

# ----
# Set Userstrings
screen_centre_pt = Point(area_2.Centroid)
area_4 = Area(Geometry=merge_5)  # -> Area, Centroid
pull = PullPoint(Point=area_4.Centroid, Geometry=screen_centre_pt, ClosestOnly=True)  # -> ClosestPoint, Distance
len = Length(Curve=merge_5)
bnd_2 = Bounds(Numbers=pull.Distance)
cull_i = CullIndex(List=area_4.Area, Indices="0", Wrap=True)
cull_i_2 = CullIndex(List=len, Indices="0", Wrap=True)
remap_3 = RemapNumbers(Value=pull.Distance, Source=bnd_2, Target=Domain(0, 1))  # -> Mapped, Clipped
gradient = Gradient(
    LowerLimit=0,
    UpperLimit=1,
    Parameter=remap_3.Mapped,
    stops=[0: RGB(0, 34, 255), 0.5: RGB(255, 0, 85), 1: RGB(255, 153, 0)])
gradient_2 = Gradient(
    LowerLimit=0,
    UpperLimit=1,
    Parameter=remap_3.Mapped,
    stops=[0: RGB(0, 98, 0), 0.25: RGB(81, 175, 17), 0.5: RGB(159, 198, 146), 0.75: RGB(170, 235, 41), 1: RGB(221, 255, 53)])
num = Number(cull_i_2)
num_2 = Number(cull_i)
c_script = CSharpScript(crv=merge_5, color=gradient, length=num, area=num_2)  # -> out, A, B, C; inputs crv: Curve, color: Color, length: String, area: String
# ---------- c_script: C# ----------
    var c = color.R + "," + color.G + "," + color.B;
    crv.SetUserString("color", c);
    A = crv;
    var d = length;
    crv.SetUserString("length", d);
    B = length;
    var e = area;
    crv.SetUserString("area", e);
    C = area;
# ---------- end c_script ----------
panel_4 = Panel(c_script.C)
panel_5 = Panel(c_script.B)

screen_surface_3 = Surface(screen_surface_2)

screen_surface_4 = Surface(screen_surface_3)
shading_srf_2 = Surface(shading_srf)
merge_6 = Merge(Data1=shading_srf_2, Data2=screen_surface_4)
localshading = Geometry(merge_6)

# ----
# 3. Load your site geometry and context
sitegeometry_2 = Geometry(sitegeometry)
openings = Geometry(openingsforfinalmassing)
shadingcontext_2 = Geometry(shadingcontext)
shadingsurfaces = Geometry(localshading)
buildingmassing = Geometry(finalmassing)

siteandbuilding = Relay([buildingmassing, sitegeometry_2])
siteandcontext = Relay([sitegeometry_2, shadingcontext_2])

# ----
# preview
wires = BrepWireframe(Brep=siteandcontext, Density=-1)
preview = CustomPreview(
    Geometry=wires,
    Material={diffuse=RGB(221, 160, 221), emission=RGB(66, 48, 66), shine=0.5, specular=RGB(255, 255, 255), transparency=0})

# ----
# 8. run solar irradiation study
filter = StreamFilter(Gate=list, Stream0=siteandbuilding, Stream1=buildingmassing, Stream2=openings)

# ---- group: Account for local shading
merge_7 = Merge(Data1=shadingcontext_2, Data2=shadingsurfaces)

# ----
incidentradiation = LBIncidentRadiation(
    sky_mtx=skymatrix.sky_mtx,
    geometry=flatten(filter),
    context=flatten(merge_7),
    grid_size=analysis_resolution_2,
    offset_dist="0.01",
    legend_par=legendpar,
    run=Toggle(True))  # -> report, points, results, total, mesh, legend, title, int_mtx; plug-in component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
ma = MassAddition(Input=incidentradiation.results)  # -> Result, PartialResults
total_radiation_kwh_m2 = Panel(incidentradiation.total)
total_insolation_kwh_m2 = Panel(ma.Result)

# ---- group: RH_OUT:Insolation
mesh_4 = Mesh(flatten(incidentradiation.mesh))

# ---- group: RH_OUT:edges
curve = Curve(flatten(c_script.A))

# ==== cluster ShowNormal
pluggeohere = ClusterInput()

# ----
# find surface normals
pluggeohere_2 = Geometry(pluggeohere)
evalsrf = EvaluateSurface(Surface=reparameterize(pluggeohere_2), Point="0.5,0.5")  # -> Point, Normal, UDirection, VDirection, Frame
amp = Amplitude(Vector=evalsrf.Normal, Amplitude="10")
vdisex = VectorDisplayEx(Point=evalsrf.Point, Vector=amp, Colour=RGB(0, 0, 0), Width=2)
